# Grasshopper definition Bot.gh (Grasshopper 1.0.4)
# plug-ins: ExcelReadWrite

timer = Timer(TimerInterval=1000, Target=bool)
toggle = BooleanToggle(True)
path = FilePath("C:\Users\Sjaak\Documents\GitHub\TwitchBot\Output.txt")
bool = Boolean([True, False])
exdread = ExcelDynamicRead(ExcelFile=path, Connect=bool, SheetNum=1, DataRange="all")  # -> DataOutput, Message
cull = CullPattern(List=exdread.DataOutput, CullPattern=[True, False])
panel = Panel(cull)
lng = ListLength(List=exdread.DataOutput)
subtraction = Subtraction(A=lng, B=Slider(10, range=0..100))
dom = ConstructDomain(DomainStart=subtraction, DomainEnd=lng)
subset = SubList(List=cull, Domain=dom, Wrap=True)  # -> flatten(List), Index
panel_2 = Panel("""0,0,0
0,-2,0
0,-4,0
0,-6,0
0,-8,0
0,-10,0
0,-12,0
0,-14,0
0,-16,0
0,-18,0
0,-20,0""")
pt = Point(panel_2)
tag = TextTag3D(Location=pt, Text=subset.List, Size=1, Justification=7)
